# Grasshopper definition Vector_Polish_sunlight_hours_compilance.gh (Grasshopper 1.0.7)

# ---- group: INPUT
# SHADOW EMITER
shadow_emiter = Brep([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])
# CONTEXT
context = Brep([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])
# LOCATION
latitiude_longitude = Panel("51.24957590033782,22.55452922746104")
height_mnpm = Panel("100")
location = Panel("Lublin")
# DATE
year = Slider(2023, range=0..10000)

# ---- group: BOUNDARY CONDITIONS
number_slider = Slider(1, range=-5..5)
# EQUIONOX DATE
number_slider_2 = Slider(3, range=1..12)
number_slider_3 = Slider(20, range=1..31)
number_slider_4 = Slider(1, range=1..12)
# ANALYSYS PERIOD
number_slider_5 = Slider(7, range=0..24)
number_slider_6 = Slider(17, range=0..24)
number_slider_7 = Slider(2, range=-5..5)
# EQUIONOX DATE
number_slider_8 = Slider(9, range=1..12)
number_slider_9 = Slider(22, range=1..31)

# ----
# SUNPATH CENTER LOCATION
sunpath_location = Point(Point(5.506657983, 2.012779294, 0))
# SEPTEMBER SIMULATION POSITION
distance_between_simulations = Slider(387, range=0..2000)

# ---- group: TEXT
join = TextJoin(Text=[number_slider_3, number_slider_2, year], Join=".")
join_2 = TextJoin(Text=[number_slider_9, number_slider_8, year], Join=".")
join_3 = TextJoin(Text=[location, join], Join=", ")
join_4 = TextJoin(Text=[location, join_2], Join=", ")

# ---- group: LOCATION
split = TextSplit(Text=latitiude_longitude, Separators=",")
item = ListItem(List=split, Index=Slider(1, range=0..1), Wrap=True)
item_2 = ListItem(List=split, Index=Slider(0, range=0..1), Wrap=True)
constrloc = LBConstructLocation(name=join_3, latitude=item_2, longitude=item, time_zone=number_slider, elevation=height_mnpm)  # -> location; plug-in component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
constrloc_2 = LBConstructLocation(name=join_4, latitude=item_2, longitude=item, time_zone=number_slider_7, elevation=height_mnpm)  # -> location; plug-in component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
entwine = Entwine(Branch00=constrloc, Branch01=constrloc_2, FlattenInputs=True)

# ----
vec = VectorXYZ(XComponent=distance_between_simulations, YComponent=0, ZComponent=0)  # -> Vector, Length
move = Move(Geometry=sunpath_location, Motion=vec.Vector)  # -> Geometry, Transform
entwine_2 = Entwine(Branch00=sunpath_location, Branch01=move.Geometry, FlattenInputs=True)

# ---- group: HOYS
analysisperiod = LBAnalysisPeriod(
    start_month=number_slider_2,
    start_day=number_slider_3,
    start_hour=number_slider_5,
    end_month=number_slider_2,
    end_day=number_slider_3,
    end_hour=number_slider_6,
    timestep=number_slider_4)  # -> period, hoys, dates; plug-in component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
analysisperiod_2 = LBAnalysisPeriod(
    start_month=number_slider_8,
    start_day=number_slider_9,
    start_hour=number_slider_5,
    end_month=number_slider_8,
    end_day=number_slider_9,
    end_hour=number_slider_6,
    timestep=number_slider_4)  # -> period, hoys, dates; plug-in component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
entwine_3 = Entwine(Branch00=analysisperiod.hoys, Branch01=analysisperiod_2.hoys, FlattenInputs=True)

# ----
sunpath = LBSunPath(location=entwine, hoys=entwine_3, solar_time=Toggle(False), center_pt=entwine_2, scale=1)  # -> report, simplify(vectors), altitudes, azimuths, hoys, sun_pts, analemma, daily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; plug-in component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

data = Data(vec.Vector)

# ---- group: VISUALIZATION RESULT
bang = ExplodeTree(Data=sunpath.vectors)  # -> Branch0, Branch1
graft = GraftTree(Tree=bang.Branch0, IncludeEmptyLists=True, IncludeNullItems=True)
graft_2 = GraftTree(Tree=bang.Branch1, IncludeEmptyLists=True, IncludeNullItems=True)
move_2 = Move(Geometry=shadow_emiter, Motion=data)  # -> Geometry, Transform
cluster = Cluster(G=shadow_emiter, D=graft)  # -> simplify(L)
cluster_2 = Cluster(G=move_2.Geometry, D=graft_2)  # -> simplify(L)
geo = Geometry(cluster)
geo_2 = Geometry(cluster_2)
cluster_3 = Cluster_2(T=geo)
cluster_4 = Cluster_2(T=geo_2)
preview = CustomPreview(Geometry=geo, Material=cluster_3)
preview_2 = CustomPreview(Geometry=geo_2, Material=cluster_4)

# ---- group: COMPASS
data_2 = Data([sunpath.compass, sunpath.title])
preview_3 = CustomPreview(Geometry=data_2, Material=ColourSwatch(SwatchColor=RGBA(125, 125, 125, 150)))

# ---- group: MODEL VISUALIZATION
swatch = ColourSwatch(SwatchColor=RGBA(232, 232, 232, 133))
move_3 = Move(Geometry=context, Motion=data)  # -> Geometry, Transform
preview_4 = CustomPreview(Geometry=context, Material=swatch)
preview_5 = CustomPreview(Geometry=move_3.Geometry, Material=swatch)

# ----
text_split = TextSplit(Text=analysisperiod.dates, Separators=" ")
list_item = ListItem(List=text_split, Index=Slider(2, range=0..10), Wrap=True)  # -> flatten(Item)

entwine_4 = Entwine(Branch00=cluster_3, Branch01=cluster_3, FlattenInputs=True)

# ---- group: SUN
circle_cnr = CircleCNR(Center=sunpath.sun_pts, Normal=Vector(0, 0, 1), Radius=Slider(2, range=0..10))
boundary_surfaces = BoundarySurfaces(Edges=circle_cnr)
custom_preview = CustomPreview(Geometry=boundary_surfaces, Material=entwine_4)

# ----
legend_location = Point(Point(122.2558377, 122.9965386, 0))

move_4 = Move(Geometry=legend_location, Motion=data)  # -> Geometry, Transform
entwine_5 = Entwine(Branch00=legend_location, Branch01=move_4.Geometry, FlattenInputs=True)

# ---- group: LEGEND
tstat = TreeStatistics(Tree=geo)  # -> Paths, Length, Count
series = Series(Start=0, Step=1, Count=tstat.Count)  # -> simplify(Series)
subtraction = Subtraction(A=tstat.Count, B=Slider(1, range=0..1))
dom = ConstructDomain(DomainStart=0, DomainEnd=subtraction)
div = DivideDomain(Domain=dom, Count=subtraction)
legendparcategorized = LBLegendParametersCategorized(
    domain=div,
    colors=entwine_4,
    categories=list_item,
    vert_or_horiz=Toggle(False),
    seg_height=Slider(1, range=0..10),
    text_height=Slider(2.2, range=0..10))  # -> leg_par; plug-in component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
createlegend = LBCreateLegend(values=series, base_plane=entwine_5, legend_par=legendparcategorized)  # -> mesh, title_obj, label_objs, label_text, colors; plug-in component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

# ----
data_3 = Data([createlegend.mesh, createlegend.label_objs])

explode = Explode(Curve=geo, Recursive=True)  # -> Segments, Vertices
deconstruct = Deconstruct(Point=explode.Vertices)  # -> XComponent, YComponent, ZComponent
sort_list = SortList(Keys=deconstruct.YComponent, ValuesA=explode.Vertices)  # -> Keys, ValuesA
reverse_list = ReverseList(List=sort_list.ValuesA)
list_item_2 = ListItem(List=reverse_list, Index=0, Wrap=True)
unit_y = UnitY(Factor=Slider(1, range=0..1))
trim_tree = TrimTree(Tree=list_item_2, Depth=1)
move_5 = Move(Geometry=trim_tree, Motion=unit_y)  # -> Geometry, Transform
text_tag_3d = TextTag3D(Location=move_5.Geometry, Text=graft(list_item), Size=Slider(1, range=0..5), Colour=cluster_3, Justification=7)

explode_2 = Explode(Curve=geo_2, Recursive=True)  # -> Segments, Vertices
deconstruct_2 = Deconstruct(Point=explode_2.Vertices)  # -> XComponent, YComponent, ZComponent
sort_list_2 = SortList(Keys=deconstruct_2.YComponent, ValuesValuesA=explode_2.Vertices)  # -> Keys, ValuesValuesA
reverse_list_2 = ReverseList(List=sort_list_2.ValuesValuesA)
list_item_3 = ListItem(List=reverse_list_2, Index=0, Wrap=True)
unit_y_2 = UnitY(Factor=Slider(1, range=0..1))
trim_tree_2 = TrimTree(Tree=list_item_3, Depth=1)
move_6 = Move(Geometry=trim_tree_2, Motion=unit_y_2)  # -> Geometry, Transform
text_tag_3d_2 = TextTag3D(Location=move_6.Geometry, Text=graft(list_item), Size=Slider(1, range=0..5), Colour=cluster_3, Justification=7)

panel = Panel("""Ladybug
Sunpath
Minimum sunlight hours
Polish building code
Daylight analysys""")
panel_2 = Panel("""The file generate traditional daylight analysys according to Polish building code.

Definition accept multiple breps.""")
exporthydra = Hydra_ExportFile(
    fileName="Vector Polish sunlight hours compilance",
    fileDescription=panel_2,
    fileTags=panel,
    includeRhino=Toggle(True),
    export=Toggle(False))  # -> out; inputs fileDescription: list, changeLog: list, fileTags: list, includeRhino: Boolean, GHForThumb: Boolean, additionalImgs: list, export: Boolean; plug-in component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

# ==== cluster Cluster
xy = XYPlane(Origin=Point(0, 0, 0))
G = ClusterInput()
D = ClusterInput()
projecta = ProjectAlong(Geometry=G, Plane=xy, Direction=D)  # -> simplify(Geometry), Transform
wires = BrepWireframe(Brep=projecta.Geometry, Density=-1)
brec = BoundingRectangle(Geometry=projecta.Geometry, Plane=PlaneXY(0, 0, 0), Axis=0, Slide=0, Union=True)  # -> Bounding, DimensionX, DimensionY
trim = TrimTree(Tree=wires, Depth=1)
pcen = PolygonCenter(Polyline=brec.Bounding)  # -> CenterV, CenterE, CenterA
join = JoinCurves(Curves=trim, Preserve=False)
scale = Scale(Geometry=brec.Bounding, Center=pcen.CenterV, Factor=Slider(1.5, range=0..10))  # -> Geometry, Transform
boundary = BoundarySurfaces(Edges=scale.Geometry)
srfsplit = SurfaceSplit(Surface=boundary, Curves=join)
disc = Discontinuity(Curve=boundary, Level=1)  # -> Points, Parameters
item = ListItem(List=srfsplit, Index=0, Wrap=True)
item_2 = ListItem(List=disc.Points, Index=0, Wrap=True)
wires_2 = BrepWireframe(Brep=item, Density=-1)
join_2 = JoinCurves(Curves=wires_2, Preserve=False)
crv_cp = CurveClosestPoint(Point=item_2, Curve=join_2)  # -> Point, Parameter, Distance
cull = CullPattern(List=join_2, CullPattern=crv_cp.Distance)
L = ClusterOutput(cull)

# ==== cluster Cluster_2
T = ClusterInput()
tstat = TreeStatistics(Tree=T)  # -> Paths, Length, Count
series = Series(Start=0, Step=1, Count=tstat.Count)
number_slider = Slider(0, range=0..100)
rev = ReverseList(List=series)
item = ListItem(List=rev, Index=number_slider, Wrap=True)
gradient = Gradient(
    LowerLimit=number_slider,
    UpperLimit=item,
    Parameter=series,
    stops=[0: RGB(243, 57, 0), 0.1: RGB(236, 27, 60), 0.2: RGB(210, 0, 118), 0.3: RGB(103, 0, 120), 0.4: RGB(39, 72, 161), 0.5: RGB(1, 192, 229), 0.6: RGB(18, 178, 90), 0.7: RGB(79, 186, 8), 0.8: RGB(220, 237, 32), 0.9: RGB(247, 159, 20), 1: RGB(242, 0, 0)])
graft = GraftTree(Tree=gradient, IncludeEmptyLists=True, IncludeNullItems=True)  # -> simplify(Tree)
T_2 = ClusterOutput(graft)
